# Grasshopper definition A-block.gh (Grasshopper 1.0.7)

# gpt-4 prompt
# Write a python script for a ghpython node in
# grasshopper for rhino3d with the rhino common
# api and the rhinoscriptsyntax api to create a
# model of an A-block, a hollow masonry unit
# with one closed end commonly used at wall
# openings.
number_slider = Slider(5.28, range=0..10)
number_slider_2 = Slider(3.75, range=0..10)
number_slider_3 = Slider(3.65, range=0..10)
a_block = GhPythonScript(
    block_width=number_slider,
    block_height=Slider(4.56, range=0..10),
    block_length=Slider(10, range=0..10),
    core_width=number_slider_2,
    core_length=number_slider_2)  # -> out, a
# ---------- a_block: Python ----------
import rhinoscriptsyntax as rs

def create_ablock(block_width, block_height, block_length, core_width, core_length):
    # Calculate the space between cores and between core and outer block
    space = (block_length - 2*core_length) / 3

    # Create the outer block
    block_id = rs.AddBox([
        [block_width/2, block_length/2, 0],
        [-block_width/2, block_length/2, 0],
        [-block_width/2, -block_length/2, 0],
        [block_width/2, -block_length/2, 0],
        [block_width/2, block_length/2, block_height],
        [-block_width/2, block_length/2, block_height],
        [-block_width/2, -block_length/2, block_height],
        [block_width/2, -block_length/2, block_height]
    ])

    # Create the two inner cores
    core1_id = rs.AddBox([
        [core_width/2, core_length/2, 0],
        [-core_width/2, core_length/2, 0],
        [-core_width/2, -core_length/2, 0],
        [core_width/2, -core_length/2, 0],
        [core_width/2, core_length/2, block_height],
        [-core_width/2, core_length/2, block_height],
        [-core_width/2, -core_length/2, block_height],
        [core_width/2, -core_length/2, block_height]
    ])

    # Position the first core relative to the center of the block in positive y-direction
    core1_id = rs.MoveObject(core1_id, [0, block_length/2 - space - core_length/2, 0])

    # Create and position the second core relative to the center of the block in negative y-direction
    core2_id = rs.CopyObject(core1_id, [0, -space - core_length, 0])

    # Subtract the cores from the block
    a = rs.BooleanDifference(block_id, [core1_id, core2_id])

    # Delete the original cores
    rs.DeleteObject(core1_id)
    rs.DeleteObject(core2_id)

    return a

# Connect the input parameters to the inputs in the ghpython node
a = create_ablock(block_width, block_height, block_length, core_width, core_length)
# ---------- end a_block ----------
geometry = Geometry(a_block.a)
panel = Panel(a_block.out)
