# Grasshopper definition Abaciscus.gh (Grasshopper 1.0.7)

# gpt-4 prompt
# Write a python script for a ghpython node in
# grasshopper for rhino3d with the rhino common
# api and the rhinoscriptsyntax api to create a
# model of a abaciscus, abaculus, a tessara used
# in mosaic tile.
number_slider = Slider(19.76, range=0..100)  # disabled
number_slider_2 = Slider(58.49, range=0..100)  # disabled
number_slider_3 = Slider(31.76, range=0..100)  # disabled
number_slider_4 = Slider(19.29, range=0..100)  # disabled
number_slider_5 = Slider(12.88, range=5..20)  # disabled
number_slider_6 = Slider(14.08, range=5..20)  # disabled
abaculus = GhPythonScript(x=number_slider, y=number_slider_2, z=number_slider_6)  # -> out, abaciscus_geometry, tesserae_geometries; disabled
# ---------- abaculus: Python ----------
import Rhino.Geometry as rg

# Define the function to create an abaciscus model
def create_abaciscus_model(radius, height, tessera_size):
    # Create the base cylinder
    base_circle = rg.Circle(rg.Plane.WorldXY, radius)
    base_cylinder = rg.Cylinder(base_circle, height)
    brep = rg.Brep.CreateFromCylinder(base_cylinder, True, True)

    # Create the tesserae on the surface of the cylinder
    tesserae = []
    u_count = int(base_circle.Circumference / tessera_size)
    v_count = int(height / tessera_size)

    for u in range(u_count):
        for v in range(v_count):
            u_parameter = u / u_count
            v_parameter = v / v_count
            circle_center = base_circle.PointAt(u_parameter)
            circle_radius = base_circle.Radius * (1 - v_parameter)
            circle = rg.Circle(circle_center, circle_radius)

            # Create planar surface from the circle
            extrusion_vector = rg.Vector3d(0, 0, height)
            planar_surface = rg.Surface.CreateExtrusion(circle.ToNurbsCurve(), extrusion_vector)
            planar_brep = planar_surface.ToBrep()

            if planar_brep:
                tesserae.append(planar_brep)

    return brep, tesserae

# Set the input parameters
radius = x
height = y
tessera_size = z

# Create the abaciscus model
abaciscus_brep, tesserae_breps = create_abaciscus_model(radius, height, tessera_size)

# Check if the tesserae list is empty
if not tesserae_breps:
    tesserae_breps = [None]

# Output the abaciscus model and tesserae to variables
abaciscus_geometry = abaciscus_brep
tesserae_geometries = tesserae_breps
# ---------- end abaculus ----------
abaculus_2 = GhPythonScript(x=number_slider_3, y=number_slider_4, z=number_slider_5)  # -> out, abaciscus_geometry, tesserae_geometries; disabled
# ---------- abaculus_2: Python ----------
import Rhino.Geometry as rg
import math

# Define the function to create an abaciscus model
def create_abaciscus_model(radius, height, tessera_size):
    # Create the base cylinder
    base_circle = rg.Circle(rg.Plane.WorldXY, radius)
    base_cylinder = rg.Cylinder(base_circle, height)
    brep = rg.Brep.CreateFromCylinder(base_cylinder, True, True)

    # Create the tesserae on the surface of the cylinder
    tesserae = []

    # Define tessera properties
    tessera_radius = tessera_size / 2.0
    tessera_height = tessera_size

    u_count = int(base_circle.Circumference / tessera_size)
    v_count = int(height / tessera_height)

    for u in range(u_count):
        for v in range(v_count):
            u_parameter = u / u_count
            v_parameter = v / v_count

            # Calculate the angle for each tessera
            angle = math.pi * 2 * (u_parameter + 0.5 * (v_parameter % 2))

            # Create a tessera as a cylinder
            tessera_circle = rg.Circle(rg.Point3d(radius * math.cos(angle), radius * math.sin(angle), v * tessera_height), tessera_radius)
            tessera_cylinder = rg.Cylinder(tessera_circle, tessera_height)
            tessera_brep = rg.Brep.CreateFromCylinder(tessera_cylinder, True, True)

            if tessera_brep:
                tesserae.append(tessera_brep)

    return brep, tesserae

# Set the input parameters
radius = 10.0
height = 20.0
tessera_size = 1.0

# Create the abaciscus model
abaciscus_brep, tesserae_breps = create_abaciscus_model(radius, height, tessera_size)

# Check if the tesserae list is empty
if not tesserae_breps:
    tesserae_breps = [None]

# Output the abaciscus model and tesserae to variables
abaciscus_geometry = abaciscus_brep
tesserae_geometries = tesserae_breps
# ---------- end abaculus_2 ----------
geometry = Geometry(abaculus_2.abaciscus_geometry)  # disabled
geometry_2 = Geometry(abaculus_2.tesserae_geometries)  # disabled
geometry_3 = Geometry(abaculus.tesserae_geometries)  # disabled
panel = Panel(abaculus.out)  # disabled
geometry_4 = Geometry(abaculus.abaciscus_geometry)  # disabled
panel_2 = Panel(abaculus_2.out)  # disabled
