# Grasshopper definition Abacus.gh (Grasshopper 1.0.7)

# ----
# Write a python script for a ghpython node in
# grasshopper for rhino3d with the rhino common
# api and the rhinoscriptsyntax api to create a
# model of a abacus, the top component of a column capital.
max_displacement = Slider(3.6, range=0..10)
num_cylinders = Slider(100, range=0..100)  # disabled
min_diameter = Slider(10, range=0..10)  # disabled
max_diameter = Slider(2, range=0..10)  # disabled
min_height = Slider(14.6, range=0..100)  # disabled
max_height = Slider(82.1, range=0..100)  # disabled
spacing = Slider(1.2, range=0..10)  # disabled
max_rotation = Slider(38.611, range=1..360)
num_cylinders_2 = Slider(100, range=0..100)  # disabled
min_diameter_2 = Slider(10, range=0..10)  # disabled
max_diameter_2 = Slider(2, range=0..10)  # disabled
min_height_2 = Slider(14.6, range=0..100)  # disabled
max_height_2 = Slider(82.1, range=0..100)  # disabled
spacing_2 = Slider(1.2, range=0..10)  # disabled
num_cylinders_3 = Slider(100, range=0..100)
min_diameter_3 = Slider(2.8, range=0..10)
max_diameter_3 = Slider(8, range=0..10)
min_height_3 = Slider(10.6, range=0..100)
max_height_3 = Slider(59.8, range=0..100)
# gpt-4 prompt
ghpython_script = GhPythonScript()  # -> out, a; disabled
# ---------- ghpython_script: Python ----------
import rhinoscriptsyntax as rs
import Rhino.Geometry as rg

# Parameters
diameter = 10.0 # Diameter of the abacus
height = 1.0    # Height of the abacus

# Center of the base of the abacus
center = rg.Point3d(0, 0, 0)

# Top of the cylinder
top = rg.Point3d(0, 0, height)

# Create the abacus as a cylinder
abacus_id = rs.AddCylinder(center, top, diameter / 2)

if abacus_id:
    rs.SelectObject(abacus_id)
    print('Abacus created and selected')
    a = abacus_id # output to variable 'a'
else:
    print('Failed to create abacus')
    a = None
# ---------- end ghpython_script ----------
abacus = GhPythonScript()  # -> out, a; disabled
# ---------- abacus: Python ----------
import math
import random
import rhinoscriptsyntax as rs
import Rhino.Geometry as rg

# Parameters
rows = 5 # Number of rows in the grid
columns = 5 # Number of columns in the grid
min_diameter = 1.0 # Minimum diameter of a cylinder
max_diameter = 3.0 # Maximum diameter of a cylinder
min_height = 0.5 # Minimum height of a cylinder
max_height = 2.0 # Maximum height of a cylinder
spacing = 4.0 # Spacing between the cylinders

# List to hold the ids of the cylinders
cylinders = []

# Create the cylinders
for i in range(rows):
    for j in range(columns):
        # Calculate the center of the base of the cylinder
        center = rg.Point3d(i * spacing, j * spacing, 0)

        # Calculate the top of the cylinder
        height = random.uniform(min_height, max_height)
        top = rg.Point3d(i * spacing, j * spacing, height)

        # Calculate the diameter of the cylinder
        diameter = random.uniform(min_diameter, max_diameter)

        # Create the cylinder
        cylinder_id = rs.AddCylinder(center, top, diameter / 2)

        # If the cylinder was created successfully, add its id to the list
        if cylinder_id:
            cylinders.append(cylinder_id)

# Output the list of cylinder ids
a = cylinders
# ---------- end abacus ----------
abacus_2 = GhPythonScript(x=num_cylinders, y=min_diameter, z=max_diameter, u=min_height, v=max_height, w=spacing)  # -> out, a; inputs x: Int32; disabled
# ---------- abacus_2: Python ----------
import math
import random
import rhinoscriptsyntax as rs
import Rhino.Geometry as rg

# Parameters
num_cylinders = x # Number of cylinders
min_diameter = y # Minimum diameter of a cylinder
max_diameter = z # Maximum diameter of a cylinder
min_height = u # Minimum height of a cylinder
max_height = v # Maximum height of a cylinder
spacing = w # Spacing between the cylinders

# The golden angle (in degrees)
golden_angle = 137.508

# List to hold the ids of the cylinders
cylinders = []

# Create the cylinders
for i in range(num_cylinders):
    # Calculate the angle (convert from degrees to radians)
    angle = math.radians(i * golden_angle)

    # Calculate the radius of the spiral at this point
    radius = i * spacing

    # Calculate the x and y coordinates
    x = radius * math.cos(angle)
    y = radius * math.sin(angle)

    # Calculate the center of the base of the cylinder
    center = rg.Point3d(x, y, 0)

    # Calculate the top of the cylinder
    height = random.uniform(min_height, max_height)
    top = rg.Point3d(x, y, height)

    # Calculate the diameter of the cylinder
    diameter = random.uniform(min_diameter, max_diameter)

    # Create the cylinder
    cylinder_id = rs.AddCylinder(center, top, diameter / 2)

    # If the cylinder was created successfully, add its id to the list
    if cylinder_id:
        cylinders.append(cylinder_id)

# Output the list of cylinder ids
a = cylinders
# ---------- end abacus_2 ----------
abacus_3 = GhPythonScript(x=num_cylinders_2, y=min_diameter_2, z=max_diameter_2, u=min_height_2, v=max_height_2, w=spacing_2)  # -> out, a; inputs x: Int32; disabled; same code as abacus_2
abacus_4 = GhPythonScript(
    x=num_cylinders_3,
    y=min_diameter_3,
    z=max_diameter_3,
    u=min_height_3,
    v=max_height_3,
    w=max_displacement,
    s=max_rotation)  # -> out, a; inputs x: Int32
# ---------- abacus_4: Python ----------
import math
import random
import rhinoscriptsyntax as rs
import Rhino.Geometry as rg

# Parameters
num_cylinders = x # Number of cylinders
min_diameter = y # Minimum diameter of a cylinder
max_diameter = z # Maximum diameter of a cylinder
min_height = u # Minimum height of a cylinder
max_height = v # Maximum height of a cylinder
max_displacement = w # Maximum displacement of a cylinder
max_rotation = s # Maximum rotation of a cylinder (in degrees)

# List to hold the ids of the cylinders
cylinders = []

# Create the cylinders
for i in range(num_cylinders):
    # Calculate the center of the base of the cylinder
    x = i + random.uniform(-max_displacement, max_displacement)
    y = i + random.uniform(-max_displacement, max_displacement)
    z = random.uniform(-max_displacement, max_displacement)
    center = rg.Point3d(x, y, z)

    # Calculate the top of the cylinder
    height = random.uniform(min_height, max_height)
    top = rg.Point3d(x, y, z + height)

    # Calculate the diameter of the cylinder
    diameter = random.uniform(min_diameter, max_diameter)

    # Create the cylinder
    cylinder_id = rs.AddCylinder(center, top, diameter / 2)

    # If the cylinder was created successfully, rotate it and add its id to the list
    if cylinder_id:
        # Rotate around the X, Y, and Z axes separately
        rs.RotateObject(cylinder_id, center, random.uniform(-max_rotation, max_rotation), rg.Vector3d.XAxis)
        rs.RotateObject(cylinder_id, center, random.uniform(-max_rotation, max_rotation), rg.Vector3d.YAxis)
        rs.RotateObject(cylinder_id, center, random.uniform(-max_rotation, max_rotation), rg.Vector3d.ZAxis)
        cylinders.append(cylinder_id)

# Output the list of cylinder ids
a = cylinders
# ---------- end abacus_4 ----------
panel = Panel(ghpython_script.out)  # disabled
panel_2 = Panel(abacus.out)  # disabled
geometry = Geometry(abacus_2.a)  # disabled
panel_3 = Panel(abacus_2.out)  # disabled
geometry_2 = Geometry(abacus_3.a)  # disabled
panel_4 = Panel(abacus_3.out)  # disabled
geometry_3 = Geometry(abacus_4.a)
panel_5 = Panel(abacus_4.out)
geometry_4 = Geometry(ghpython_script.a)  # disabled
geometry_5 = Geometry(abacus.a)  # disabled
