# Grasshopper definition Abamurus.gh (Grasshopper 1.0.7)

# ----
# Write a python script for a ghpython node in
# grasshopper for rhino3d with the rhino common
# api and the rhinoscriptsyntax api to create a
# model of a abamurus, A masonay buttress for the support of a wall.
number_slider = Slider(5.8, range=0..10)
curve = Curve([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])
# gpt-4 prompt
abamurus = GhPythonScript()  # -> out, a
# ---------- abamurus: Python ----------
import rhinoscriptsyntax as rs
import Rhino.Geometry as rg

# Define your parameters
origin = rg.Point3d(0, 0, 0)  # this should be an input
width = 2.0  # this should be an input
depth = 4.0  # this should be an input
height = 10.0  # this should be an input

# Define the corners of the base
corner1 = rg.Point3d(origin.X - width/2, origin.Y - depth/2, origin.Z)
corner2 = rg.Point3d(origin.X + width/2, origin.Y - depth/2, origin.Z)
corner3 = rg.Point3d(origin.X + width/2, origin.Y + depth/2, origin.Z)
corner4 = rg.Point3d(origin.X - width/2, origin.Y + depth/2, origin.Z)

# Create the base rectangle
base = rg.Polyline([corner1, corner2, corner3, corner4, corner1])

# Extrude the base to create the buttress
buttress = rg.Brep.CreateFromSurface(rg.Surface.CreateExtrusion(base.ToNurbsCurve(), rg.Vector3d.ZAxis * height))

# Output the buttress to the Grasshopper document
if buttress is not None and buttress.IsValid:
    a = buttress
# ---------- end abamurus ----------
abamurus_2 = GhPythonScript(x=curve, y=number_slider, z=Slider(5.13, range=0..10), u=Slider(10, range=0..10), v=Slider(7, range=0..100))  # -> out, a; inputs x: Curve, v: Int32
# ---------- abamurus_2: Python ----------
import rhinoscriptsyntax as rs
import Rhino.Geometry as rg

# Define your parameters
curve = x  # this should be an input
width = y  # this should be an input
depth = z  # this should be an input
height = u  # this should be an input
divisions = v  # this should be an input

# List to hold the buttresses
buttresses = []

# Divide the curve into points
params = curve.DivideByCount(divisions, True)

for param in params:
    # Get the point and tangent vector at each parameter
    point = curve.PointAt(param)
    tangent = curve.TangentAt(param)
    
    # Calculate the normal vector for the buttress at this point
    normal = rg.Vector3d.CrossProduct(tangent, rg.Vector3d.ZAxis)
    normal.Unitize()
    normal *= width/2  # half the width of the buttress
    
    # Calculate the direction for the depth of the buttress
    direction = rg.Vector3d.CrossProduct(normal, rg.Vector3d.ZAxis)
    direction.Unitize()
    direction *= depth/2  # half the depth of the buttress
    
    # Define the corners of the base
    corner1 = point + normal - direction
    corner2 = point - normal - direction
    corner3 = point - normal + direction
    corner4 = point + normal + direction

    # Create the base rectangle
    base = rg.Polyline([corner1, corner2, corner3, corner4, corner1])

    # Extrude the base to create the buttress
    buttress = rg.Brep.CreateFromSurface(rg.Surface.CreateExtrusion(base.ToNurbsCurve(), rg.Vector3d.ZAxis * height))

    # Add the buttress to the list
    if buttress is not None and buttress.IsValid:
        buttresses.append(buttress)

# Output the buttresses to the Grasshopper document
if len(buttresses) > 0:
    a = buttresses
# ---------- end abamurus_2 ----------
panel = Panel(abamurus.out)
panel_2 = Panel(abamurus_2.out)
geometry = Geometry(abamurus.a)
geometry_2 = Geometry(abamurus_2.a)

# ---- group: walls
geometry_3 = Geometry([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])
