# Grasshopper definition Abat_jour.gh (Grasshopper 1.0.7)

number_slider = Slider(12, range=0..100)  # disabled
construct_point = ConstructPoint(XCoordinate=0, YCoordinate=0, ZCoordinate=0)
number_slider_2 = Slider(23.56, range=0..100)  # disabled
number_slider_3 = Slider(27.64, range=0..100)  # disabled
# gpt-4 prompt
# Write a python script for a ghpython node in
# grasshopper for rhino3d with the rhino common
# api and the rhinoscriptsyntax api to create a
# model of an abat-jour, a sloped opening in a
# roof or wall designed to direct
# daylight downward.
construct_point_2 = ConstructPoint(XCoordinate=0, YCoordinate=0, ZCoordinate=0)  # disabled
construct_point_3 = ConstructPoint(XCoordinate=number_slider, YCoordinate=0, ZCoordinate=0)  # disabled
curve = Curve(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)
construct_point_4 = ConstructPoint(XCoordinate=Slider(17, range=0..100), YCoordinate=0, ZCoordinate=0)
boundary_surfaces = BoundarySurfaces(Edges=curve)
abat_jour = GhPythonScript(bottom_pt1=construct_point_2, bottom_pt2=construct_point_3, top_height=number_slider_2, opening_width=number_slider_3)  # -> out, a; inputs bottom_pt1: Point3d, bottom_pt2: Point3d; disabled
# ---------- abat_jour: Python ----------
import Rhino
import rhinoscriptsyntax as rs
import scriptcontext as sc

# Inputs:
# bottom_pt1, bottom_pt2: the points defining the bottom edge of the opening
# top_height: the height of the top edge of the opening
# opening_width: the width of the opening at the top edge

# Calculate the midpoint of the bottom edge and move it upwards to the top_height to create the top midpoint
midpoint_top = Rhino.Geometry.Point3d((bottom_pt1.X + bottom_pt2.X)/2, (bottom_pt1.Y + bottom_pt2.Y)/2, top_height)

# Define the two points at the top edge
top_pt1 = Rhino.Geometry.Point3d(midpoint_top.X - opening_width/2, midpoint_top.Y, top_height)
top_pt2 = Rhino.Geometry.Point3d(midpoint_top.X + opening_width/2, midpoint_top.Y, top_height)

# Create the lines representing the edges of the opening
line1 = Rhino.Geometry.Line(bottom_pt1, top_pt1)
line2 = Rhino.Geometry.Line(bottom_pt2, top_pt2)

# Create the surface of the opening
surface = Rhino.Geometry.Brep.CreateFromLoft([line1.ToNurbsCurve(), line2.ToNurbsCurve()], Rhino.Geometry.Point3d.Unset, Rhino.Geometry.Point3d.Unset, Rhino.Geometry.LoftType.Normal, False)[0]

# Output the surface to variable a
a = surface
# ---------- end abat_jour ----------
abat_jour_2 = GhPythonScript(
    wall_surface=boundary_surfaces,
    bottom_pt1=construct_point,
    bottom_pt2=construct_point_4,
    top_height=Slider(42.54, range=0..100),
    opening_width=Slider(6.8, range=0..100))  # -> out, a; inputs wall_surface: Surface, bottom_pt1: Point3d, bottom_pt2: Point3d
# ---------- abat_jour_2: Python ----------
import Rhino
import rhinoscriptsyntax as rs
import scriptcontext as sc

# Inputs:
# wall_surface: the surface of the wall
# bottom_pt1, bottom_pt2: the points defining the bottom edge of the opening
# top_height: the height of the top edge of the opening
# opening_width: the width of the opening at the top edge

# Calculate the midpoint of the bottom edge and move it upwards to the top_height to create the top midpoint
midpoint_top = Rhino.Geometry.Point3d((bottom_pt1.X + bottom_pt2.X)/2, (bottom_pt1.Y + bottom_pt2.Y)/2, top_height)

# Define the two points at the top edge
top_pt1 = Rhino.Geometry.Point3d(midpoint_top.X - opening_width/2, midpoint_top.Y, top_height)
top_pt2 = Rhino.Geometry.Point3d(midpoint_top.X + opening_width/2, midpoint_top.Y, top_height)

# Create the lines representing the edges of the opening
line1 = Rhino.Geometry.Line(bottom_pt1, top_pt1)
line2 = Rhino.Geometry.Line(bottom_pt2, top_pt2)

# Create the surface of the opening
opening_surface = Rhino.Geometry.Brep.CreateFromLoft([line1.ToNurbsCurve(), line2.ToNurbsCurve()], Rhino.Geometry.Point3d.Unset, Rhino.Geometry.Point3d.Unset, Rhino.Geometry.LoftType.Normal, False)[0]

# Convert the input surface to a Brep
wall_surface_brep = wall_surface.ToBrep()

# Split the wall_surface using the opening_surface
split_breps = Rhino.Geometry.Brep.Split(wall_surface_brep, opening_surface, sc.doc.ModelAbsoluteTolerance)

# Check if the Split method was successful
if split_breps:
    # Select the larger part of the split wall, assuming that's the part you want to keep
    wall_after_split = max(split_breps, key=lambda brep: brep.GetArea())

    # Output the final wall to variable a
    a = wall_after_split

    # Output the opening to variable b
    b = opening_surface
else:
    print("Failed to split the wall surface")
# ---------- end abat_jour_2 ----------
abat_jour_3 = GhPythonScript()  # -> out, a; disabled
# ---------- abat_jour_3: Python ----------
import Rhino
import rhinoscriptsyntax as rs
import scriptcontext as sc

# Define the two points at the bottom
point1 = Rhino.Geometry.Point3d(0, 0, 0)
point2 = Rhino.Geometry.Point3d(10, 0, 0)

# Define the width of the opening at the top
opening_width = 5

# Calculate the midpoint and move it upward to create a slope
midpoint = Rhino.Geometry.Point3d((point1.X + point2.X)/2, (point1.Y + point2.Y)/2, 10)

# Define the two points at the top
point3 = Rhino.Geometry.Point3d(midpoint.X - opening_width/2, 0, 10)
point4 = Rhino.Geometry.Point3d(midpoint.X + opening_width/2, 0, 10)

# Create the lines representing the edges of the opening
line1 = Rhino.Geometry.Line(point1, point3)
line2 = Rhino.Geometry.Line(point2, point4)

# Create the surface of the opening
surface = Rhino.Geometry.Brep.CreateFromLoft([line1.ToNurbsCurve(), line2.ToNurbsCurve()], Rhino.Geometry.Point3d.Unset, Rhino.Geometry.Point3d.Unset, Rhino.Geometry.LoftType.Normal, False)[0]

# Output the surface to variable a
a = surface
# ---------- end abat_jour_3 ----------
panel = Panel(abat_jour_3.out)  # disabled
panel_2 = Panel(abat_jour.out)  # disabled
panel_3 = Panel(abat_jour_2.out)
geometry = Geometry(abat_jour_3.a)  # disabled
geometry_2 = Geometry(abat_jour.a)  # disabled
geometry_3 = Geometry(abat_jour_2.a)
