# Grasshopper definition Abatsons.gh (Grasshopper 1.0.7)

construct_point = ConstructPoint(XCoordinate=0, YCoordinate=0, ZCoordinate=0)  # disabled
number_slider = Slider(10.3, range=0..100)  # disabled
number_slider_2 = Slider(9, range=0..100)  # disabled
number_slider_3 = Slider(15.9, range=0..100)  # disabled
number_slider_4 = Slider(4.8, range=0..100)  # disabled
number_slider_5 = Slider(4, range=0..10)  # disabled
number_slider_6 = Slider(35, range=0..100)  # disabled
number_slider_7 = Slider(6.92, range=0..10)  # disabled
# gpt-4 prompt
# Write a python script for a ghpython node in
# grasshopper for rhino3d with the rhino common
# api and the rhinoscriptsyntax api to create a
# model of an abatsons, acoustical reflections
# for directing sound waves.
construct_point_2 = ConstructPoint(XCoordinate=0, YCoordinate=0, ZCoordinate=0)  # disabled
number_slider_8 = Slider(100, range=0..100)  # disabled
number_slider_9 = Slider(100, range=0..100)  # disabled
abatsons = GhPythonScript(center=construct_point_2, radius=number_slider, count=number_slider_2, reflector_height=number_slider_3)  # -> out, a; inputs center: Point3d, count: Int32; disabled
# ---------- abatsons: Python ----------
import Rhino
import rhinoscriptsyntax as rs
import math

# inputs
# center : The center of the abatsons
# radius : The radius of the abatsons
# count : The number of abatsons to create
# reflector_height : The height of the reflector

def create_abatsons(center, radius, count, reflector_height):
    abatsons = []

    for i in range(count):
        angle = i * 2 * math.pi / count
        x = center.X + radius * math.cos(angle)
        y = center.Y + radius * math.sin(angle)
        abatson_center = Rhino.Geometry.Point3d(x, y, 0)

        # Create the reflector curve
        reflector_plane = Rhino.Geometry.Plane(abatson_center, Rhino.Geometry.Vector3d.ZAxis)
        reflector_crv = Rhino.Geometry.Circle(reflector_plane, radius).ToNurbsCurve()

        # Create the revolved surface
        axis = Rhino.Geometry.Line(center, center + Rhino.Geometry.Vector3d.ZAxis)
        rev_surface = Rhino.Geometry.RevSurface.Create(reflector_crv, axis, 0, angle)

        # Create the abatson
        abatson = Rhino.Geometry.Brep.CreateFromRevSurface(rev_surface, True, True)
        if abatson:
            abatsons.append(abatson)

    return abatsons

def main(center, radius, count, reflector_height):
    abatsons = create_abatsons(center, radius, count, reflector_height)

    if abatsons:
        print("Abatsons created successfully.")
        return abatsons
    else:
        print("Failed to create abatsons.")
        return None

"""
center = Rhino.Geometry.Point3d(0, 0, 0)
radius = 10
count = 8
reflector_height = 5
"""

a = main(center, radius, count, reflector_height)
# ---------- end abatsons ----------
abatsons_2 = GhPythonScript(
    center=construct_point,
    radius=number_slider_4,
    count=number_slider_5,
    reflector_height=number_slider_6,
    z_offset=number_slider_7)  # -> out, a; inputs center: Point3d, count: Int32; disabled
# ---------- abatsons_2: Python ----------
import Rhino
import rhinoscriptsyntax as rs
import math

# inputs
# center : The center of the abatsons
# radius : The radius of the abatsons
# count : The number of abatsons to create
# reflector_height : The height of the reflector
# z_offset : The offset in the Z-axis direction to avoid coincident surfaces

def create_abatsons(center, radius, count, reflector_height, z_offset):
    abatsons = []

    for i in range(count):
        angle = i * 2 * math.pi / count
        x = center.X + radius * math.cos(angle)
        y = center.Y + radius * math.sin(angle)
        abatson_center = Rhino.Geometry.Point3d(x, y, 0)

        # Create the reflector curve
        reflector_plane = Rhino.Geometry.Plane(abatson_center, Rhino.Geometry.Vector3d.ZAxis)
        reflector_crv = Rhino.Geometry.Circle(reflector_plane, radius).ToNurbsCurve()

        # Extrude the reflector curve
        extrusion_distance = reflector_height
        reflector_extrusion = Rhino.Geometry.Extrusion.Create(reflector_crv, extrusion_distance, cap=True)
        if reflector_extrusion:
            profile_curve = reflector_extrusion.ToBrep().GetWireframe(0)[0]
        else:
            continue

        # Create the revolved surface
        axis = Rhino.Geometry.Line(center, center + Rhino.Geometry.Vector3d.ZAxis)
        rev_surface = Rhino.Geometry.RevSurface.Create(profile_curve, axis, z_offset, angle)

        # Create the abatson
        abatson = Rhino.Geometry.Brep.CreateFromRevSurface(rev_surface, True, True)
        if abatson:
            abatsons.append(abatson)

    return abatsons

def main(center, radius, count, reflector_height, z_offset):
    abatsons = create_abatsons(center, radius, count, reflector_height, z_offset)

    if abatsons:
        print("Abatsons created successfully.")
        return abatsons
    else:
        print("Failed to create abatsons.")
        return None

"""
center = Rhino.Geometry.Point3d(0, 0, 0)
radius = 10
count = 8
reflector_height = 5
z_offset = 0.1  # Adjust the offset value as needed
"""
a = main(center, radius, count, reflector_height, z_offset)
# ---------- end abatsons_2 ----------
geometry = Geometry(abatsons.a)  # disabled
list_length = ListLength(List=geometry)  # disabled
range = Range(Domain=number_slider_8, Steps=expr("x-1", list_length))  # disabled
geometry_2 = Geometry(abatsons_2.a)  # disabled
list_length_2 = ListLength(List=geometry_2)  # disabled
range_2 = Range(Domain=number_slider_9, Steps=expr("x-1", list_length_2))  # disabled
panel = Panel(abatsons.out)  # disabled
panel_2 = Panel(abatsons_2.out)  # disabled
unit_z = UnitZ(Factor=range)  # disabled
unit_z_2 = UnitZ(Factor=range_2)  # disabled
move = Move(Geometry=geometry, Motion=unit_z)  # -> Geometry, Transform; disabled
move_2 = Move(Geometry=geometry_2, Motion=unit_z_2)  # -> Geometry, Transform; disabled
