# Grasshopper definition Abatvent.gh (Grasshopper 1.0.7)

# gpt-4 prompt
# Write a python script for a ghpython node in
# grasshopper for rhino3d with the rhino common
# api and the rhinoscriptsyntax api to create a
# model of an abatvent, a wall louver that restricts wind from
#  entering a building, but admits light and air.
number_slider = Slider(0, range=0..10)
abatvent = GhPythonScript(
    spx=number_slider,
    spy=Slider(0, range=0..10),
    spz=Slider(0, range=0..10),
    x=Slider(0, range=0..10),
    y=Slider(0, range=0..10),
    z=Slider(1.33, range=0..10),
    ll=Slider(100, range=0..100),
    lw=Slider(11.91, range=0..100),
    lh=Slider(9.13, range=0..100),
    g=Slider(0, range=0..100),
    n=Slider(5, range=0..10),
    u=Slider(0, range=0..180))  # -> out, a; inputs n: Int32
# ---------- abatvent: Python ----------
import Rhino
import scriptcontext
import math

def create_louver(start_point, direction_vector, louver_length, louver_width, louver_height):
    corner1 = start_point
    corner2 = start_point + (direction_vector * louver_length)
    corner3 = corner2 + (Rhino.Geometry.Vector3d.ZAxis * louver_height)
    corner4 = corner1 + (Rhino.Geometry.Vector3d.ZAxis * louver_height)

    louver = Rhino.Geometry.Brep.CreateFromCornerPoints(corner1, corner2, corner3, corner4, tolerance=0.01)
    return louver

def create_vent(start_point, direction_vector, louver_length, louver_width, louver_height, gap, num_louvers):
    # Create a list to store the louvers
    louvers = []

    for i in range(num_louvers):
        # Calculate the start point of each louver
        louver_start = start_point + (direction_vector * (louver_width + gap) * i)
        
        # Create a louver
        louver = create_louver(louver_start, Rhino.Geometry.Vector3d.XAxis, louver_length, louver_width, louver_height)
        
        # Rotate the louver to a 0..180 degree angle
        rotation_plane = Rhino.Geometry.Plane(louver_start, Rhino.Geometry.Vector3d.ZAxis)
        louver.Transform(Rhino.Geometry.Transform.Rotation(math.radians(u), rotation_plane.Normal, louver_start))
        
        if louver:
            louvers.append(louver)

    return louvers

# Set the start_point and direction_vector parameters
start_point = Rhino.Geometry.Point3d(spx, spy, spz) # Replace with the appropriate Grasshopper input
direction_vector = Rhino.Geometry.Vector3d(x, y, z) # Replace with the appropriate Grasshopper input

# Set the parameters for the vent
louver_length = ll # Replace with the appropriate Grasshopper input
louver_width = lw # Replace with the appropriate Grasshopper input
louver_height = lh # Replace with the appropriate Grasshopper input
gap = g # Replace with the appropriate Grasshopper input
num_louvers = n # Replace with the appropriate Grasshopper input

# Create the vent and output the result
a = create_vent(start_point, direction_vector, louver_length, louver_width, louver_height, gap, num_louvers)
# ---------- end abatvent ----------
abatvent_2 = GhPythonScript()  # -> out, a; disabled
# ---------- abatvent_2: Python ----------
import Rhino
import scriptcontext
import rhinoscriptsyntax as rs
import math

def create_louver(start_point, direction_vector, louver_width, louver_height, louver_depth, gap, num_louvers):
    # Create a list to store the louvers
    louvers = []
    
    for i in range(num_louvers):
        # Calculate the start point of each louver
        louver_start = start_point + (direction_vector * (louver_depth + gap) * i)
        
        # Create the four corners of the louver
        corner1 = louver_start
        corner2 = louver_start + (direction_vector * louver_depth)
        corner3 = corner2 + (Rhino.Geometry.Vector3d.YAxis * louver_height)
        corner4 = corner1 + (Rhino.Geometry.Vector3d.YAxis * louver_height)
        
        # Create the louver from the four corners
        louver = Rhino.Geometry.Brep.CreateFromCornerPoints(corner1, corner2, corner3, corner4, tolerance=0.01)
        
        if louver:
            louvers.append(louver)
    
    # Return the list of louvers
    return louvers

# Example usage
start_point = Rhino.Geometry.Point3d(0, 0, 0)
direction_vector = Rhino.Geometry.Vector3d.XAxis
a = create_louver(start_point, direction_vector, louver_width=2, louver_height=1, louver_depth=0.1, gap=0.1, num_louvers=10)
# ---------- end abatvent_2 ----------
geometry = Geometry(abatvent.a)
geometry_2 = Geometry(abatvent_2.a)  # disabled
panel = Panel(abatvent_2.out)  # disabled
panel_2 = Panel(abatvent.out)
