# Grasshopper definition Abreuvoir.gh (Grasshopper 1.0.7)

abreuvoir = GhPythonScript(
    brick_length=Slider(25.33, range=0..100),
    brick_width=Slider(12, range=0..100),
    brick_height=Slider(6, range=0..10),
    mortar_thickness=Slider(2.044, range=0..10))  # -> out, a, b, c
# ---------- abreuvoir: Python ----------
import Rhino

def create_brick(length, width, height):
    # Create a rectangular solid that represents a brick
    box = [Rhino.Geometry.Point3d(0, 0, 0), Rhino.Geometry.Point3d(length, 0, 0),
            Rhino.Geometry.Point3d(length, width, 0), Rhino.Geometry.Point3d(0, width, 0),
            Rhino.Geometry.Point3d(0, 0, height), Rhino.Geometry.Point3d(length, 0, height),
            Rhino.Geometry.Point3d(length, width, height), Rhino.Geometry.Point3d(0, width, height)]
    brick = Rhino.Geometry.Brep.CreateFromBox(box)
    return brick

def create_mortar_joint(brick, mortar_thickness):
    # Create a mortar joint around a brick
    box = brick.GetBoundingBox(False)
    box.Inflate(mortar_thickness)
    mortar_joint = Rhino.Geometry.Brep.CreateFromBox(box)
    return mortar_joint

def main():
    # Parameters for bricks and mortar joint


    # Create central brick
    central_brick = create_brick(brick_length, brick_width, brick_height)
    
    # Create surrounding bricks in cardinal directions
    translations = [(0, 0, -brick_height - mortar_thickness),
                    (0, 0, brick_height + mortar_thickness),
                    (-brick_length - mortar_thickness, 0, 0),
                    (brick_length + mortar_thickness, 0, 0),
                    #(0, -brick_width - mortar_thickness, 0),
                    #(0, brick_width + mortar_thickness, 0)
                    ]
    
    surrounding_bricks = []
    for translation in translations:
        transform = Rhino.Geometry.Transform.Translation(*translation)
        brick = create_brick(brick_length, brick_width, brick_height)
        brick.Transform(transform)
        surrounding_bricks.append(brick)
    
    # Create mortar joint
    mortar_joint = create_mortar_joint(central_brick, mortar_thickness)

    # Output the geometries
    return central_brick, surrounding_bricks, mortar_joint

# Call the main function
a, b, c = main()
# ---------- end abreuvoir ----------
# gpt-4 prompt
# Write a python script for a ghpython node in
# grasshopper for rhino3d with the rhino common
# api and the rhinoscriptsyntax api to create a
# model of an Abreuvoir, a mortar joint between
#  masonry units.  Output the geometries as
#  variables a in the ghpython node.
abreuvoir_2 = GhPythonScript()  # -> out, a, b, c; disabled
# ---------- abreuvoir_2: Python ----------
import Rhino

def create_brick(length, width, height):
    # Create a rectangular solid that represents a brick
    box = [Rhino.Geometry.Point3d(0, 0, 0), Rhino.Geometry.Point3d(length, 0, 0),
            Rhino.Geometry.Point3d(length, width, 0), Rhino.Geometry.Point3d(0, width, 0),
            Rhino.Geometry.Point3d(0, 0, height), Rhino.Geometry.Point3d(length, 0, height),
            Rhino.Geometry.Point3d(length, width, height), Rhino.Geometry.Point3d(0, width, height)]
    brick = Rhino.Geometry.Brep.CreateFromBox(box)
    return brick

def create_mortar_joint(brick, mortar_thickness):
    # Create a mortar joint around a brick
    box = brick.GetBoundingBox(False)
    box.Inflate(mortar_thickness)
    mortar_joint = Rhino.Geometry.Brep.CreateFromBox(box)
    return mortar_joint

def main():
    # Parameters for bricks and mortar joint
    brick_length = 200  # mm
    brick_width = 100  # mm
    brick_height = 60  # mm
    mortar_thickness = 10  # mm

    # Create central brick
    central_brick = create_brick(brick_length, brick_width, brick_height)
    
    # Create surrounding bricks in cardinal directions
    translations = [(0, 0, -brick_height - mortar_thickness),
                    (0, 0, brick_height + mortar_thickness),
                    (-brick_length - mortar_thickness, 0, 0),
                    (brick_length + mortar_thickness, 0, 0),
                    (0, -brick_width - mortar_thickness, 0),
                    (0, brick_width + mortar_thickness, 0)]
    
    surrounding_bricks = []
    for translation in translations:
        transform = Rhino.Geometry.Transform.Translation(*translation)
        brick = create_brick(brick_length, brick_width, brick_height)
        brick.Transform(transform)
        surrounding_bricks.append(brick)
    
    # Create mortar joint
    mortar_joint = create_mortar_joint(central_brick, mortar_thickness)

    # Output the geometries
    return central_brick, surrounding_bricks, mortar_joint

# Call the main function
a, b, c = main()
# ---------- end abreuvoir_2 ----------
panel = Panel(abreuvoir.out)
panel_2 = Panel(abreuvoir_2.out)  # disabled
geometry = Geometry(abreuvoir.a)
geometry_2 = Geometry(abreuvoir.b)
geometry_3 = Geometry(abreuvoir_2.a)  # disabled
geometry_4 = Geometry(abreuvoir_2.c)  # disabled
geometry_5 = Geometry(abreuvoir_2.b)  # disabled
geometry_6 = Geometry(abreuvoir.c)
