# Grasshopper definition Absorber.gh (Grasshopper 1.0.7)

absorber = GhPythonScript(
    radius=Slider(5.8, range=0..10),
    height=Slider(33, range=0..100),
    sphere_radius=Slider(4.1, range=0..10),
    base_height=Slider(1.46, range=0..10),
    supports_height=Slider(15, range=0..100),
    number_of_supports=Slider(2, range=0..10),
    pipe_radius=Slider(0.976, range=0..10),
    pipe_length=Slider(29.4, range=0..100))  # -> out, a, b, c, d, e; inputs number_of_supports: Int32
# ---------- absorber: Python ----------
import Rhino.Geometry as rg
import math

def create_cylinder(radius, height, plane=rg.Plane.WorldXY):
    base_circle = rg.Circle(plane, radius)
    cylinder = rg.Cylinder(base_circle, height)
    brep_cylinder = cylinder.ToNurbsSurface().ToBrep()
    brep_cylinder.Faces.ShrinkFaces()
    brep_cylinder = brep_cylinder.CapPlanarHoles(0.01)
    return brep_cylinder

def create_sphere(radius, center):
    sphere = rg.Sphere(center, radius)
    return sphere.ToNurbsSurface().ToBrep()

def create_supports(radius, height, number_of_supports, main_body_radius):
    supports = []
    for i in range(number_of_supports):
        angle = i * 2.0 * math.pi / number_of_supports
        bottom_point = rg.Point3d((radius + 5) * math.cos(angle), (radius + 5) * math.sin(angle), 0)
        top_point = rg.Point3d(main_body_radius * math.cos(angle), main_body_radius * math.sin(angle), height)
        path_line = rg.Line(bottom_point, top_point).ToNurbsCurve()
        cross_section_circle = rg.Circle(rg.Plane(bottom_point, rg.Vector3d.ZAxis), 0.5)
        support = rg.Brep.CreateFromSweep(path_line, cross_section_circle.ToNurbsCurve(), False, 0.01)
        support[0].Flip()
        supports.append(support[0])
    return supports


def create_bent_pipe(radius, length, position, bend_angle=math.pi/2):
    # Create a straight pipe for the initial segment
    straight_pipe = create_cylinder(radius, length/2, rg.Plane(position, rg.Vector3d.ZAxis))
    
    # Create a curve for the bent segment
    start_point = position + rg.Vector3d(length/2, 0, 0)
    end_point = start_point + rg.Vector3d(0, length/2, 0)
    mid_point = rg.Point3d(start_point.X, (start_point.Y + end_point.Y) / 2, (start_point.Z + end_point.Z) / 2)
    curve = rg.Arc(start_point, mid_point, end_point).ToNurbsCurve()
    path_line = rg.LineCurve(start_point, end_point)
    cross_section_circle = rg.Circle(rg.Plane.WorldXY, radius)
    
    # Create a bent pipe by sweeping the cross section along the curve
    bent_pipe = rg.Brep.CreateFromSweep(path_line, cross_section_circle.ToNurbsCurve(), False, 0.01)[0]
    
    return [straight_pipe, bent_pipe]

def main(radius, height, sphere_radius, base_height, supports_height, number_of_supports, pipe_radius, pipe_length):
    cylinder = create_cylinder(radius, height)
    center_point = rg.Point3d(0, 0, height)
    sphere = create_sphere(sphere_radius, center_point)
    base = create_cylinder(radius + 5, base_height)
    supports = create_supports(radius, supports_height, number_of_supports, radius)
    pipes = []
    for i in range(2):
        position = rg.Point3d((i * 2 - 1) * radius, 0, height / 2)
        pipe_parts = create_bent_pipe(pipe_radius, pipe_length, position)
        pipes.extend(pipe_parts)
    return cylinder, sphere, base, supports, pipes

cylinder, sphere, base, supports, pipes = main(radius, height, sphere_radius, base_height, supports_height, number_of_supports, pipe_radius, pipe_length)

# Output geometries
a = cylinder
b = sphere
c = base
d = supports
e = pipes
# ---------- end absorber ----------
# gpt-4 prompt
# Write a python script for a ghpython node in
# grasshopper for rhino3d with the rhino common
# api and the rhinoscriptsyntax api to create a
# model of an Absorber, a device containing liquid
#  fro the absorption of vapours.  Output the
#  geometries as variables a in the ghpython node.
absorber_2 = GhPythonScript()  # -> out, a; disabled
# ---------- absorber_2: Python ----------
import Rhino.Geometry as rg
import scriptcontext as sc
import ghpythonlib.components as ghc

def create_cylinder(radius, height):
    base_circle = rg.Circle(rg.Plane.WorldXY, radius)
    cylinder = rg.Cylinder(base_circle, height)
    brep_cylinder = cylinder.ToNurbsSurface().ToBrep()
    
    # Cap the cylinder
    brep_cylinder.Faces.ShrinkFaces()
    brep_cylinder = brep_cylinder.CapPlanarHoles(sc.doc.ModelAbsoluteTolerance)
    return brep_cylinder

def create_sphere(radius, center):
    sphere = rg.Sphere(center, radius)
    return sphere.ToNurbsSurface().ToBrep()

def main(radius, height, sphere_radius):
    # Create cylinder
    cylinder = create_cylinder(radius, height)
    
    # Create the center point for the sphere
    center_point = rg.Point3d(0, 0, height)
    
    # Create sphere at the center of the top face
    sphere = create_sphere(sphere_radius, center_point)
    
    # Create boolean union of cylinder and sphere
    absorber = ghc.SolidUnion([cylinder, sphere])
    return absorber

# The input values should be adjusted depending on the desired model size.
radius = 10
height = 30
sphere_radius = 5

absorber = main(radius, height, sphere_radius)
if not absorber:
    print("Failed to create the absorber.")
else:
    a = absorber # output geometries
# ---------- end absorber_2 ----------
absorber_3 = GhPythonScript()  # -> out, a; disabled
# ---------- absorber_3: Python ----------
import Rhino.Geometry as rg
import ghpythonlib.components as ghc
import System.Math as math

def create_cylinder(radius, height):
    base_circle = rg.Circle(rg.Plane.WorldXY, radius)
    cylinder = rg.Cylinder(base_circle, height)
    brep_cylinder = cylinder.ToNurbsSurface().ToBrep()
    
    # Cap the cylinder
    brep_cylinder.Faces.ShrinkFaces()
    brep_cylinder = brep_cylinder.CapPlanarHoles(0.01) # using a small tolerance value
    return brep_cylinder

def create_sphere(radius, center):
    sphere = rg.Sphere(center, radius)
    return sphere.ToNurbsSurface().ToBrep()

def create_supports(radius, height, number_of_supports):
    supports = []
    for i in range(number_of_supports):
        angle = i * 2.0 * math.PI / number_of_supports
        location = rg.Point3d(radius * math.Cos(angle), radius * math.Sin(angle), 0)
        support = create_cylinder(0.5, height)
        support.Translate(location - rg.Point3d.Origin)
        supports.append(support)
    return supports

def main(radius, height, sphere_radius, base_height, supports_height, number_of_supports):
    # Create cylinder
    cylinder = create_cylinder(radius, height)
    
    # Create the center point for the sphere
    center_point = rg.Point3d(0, 0, height)
    
    # Create sphere at the center of the top face
    sphere = create_sphere(sphere_radius, center_point)
    
    # Create base
    base = create_cylinder(radius + 5, base_height)
    
    # Create supports
    supports = create_supports(radius + 3, supports_height, number_of_supports)
    
    # Create boolean union of all components
    absorber = ghc.SolidUnion([cylinder, sphere, base] + supports)
    
    return absorber

# The input values should be adjusted depending on the desired model size.
radius = 10
height = 30
sphere_radius = 5
base_height = 2
supports_height = height/2
number_of_supports = 6

absorber = main(radius, height, sphere_radius, base_height, supports_height, number_of_supports)
if not absorber:
    print("Failed to create the absorber.")
else:
    a = absorber # output geometries
# ---------- end absorber_3 ----------
geometry = Geometry(absorber_2.a)  # disabled
geometry_2 = Geometry(absorber.a)
geometry_3 = Geometry(absorber.b)
geometry_4 = Geometry(absorber.c)
geometry_5 = Geometry(absorber.d)
geometry_6 = Geometry(absorber.e)
geometry_7 = Geometry(absorber_3.a)  # disabled
panel = Panel(absorber_2.out)  # disabled
panel_2 = Panel(absorber_3.out)  # disabled
panel_3 = Panel(absorber.out)
